# Grasshopper definition columns workflow.ghx (Grasshopper 1.0.8)
# plug-ins: Speckle 2

# ---- group: RH_IN:Send
txt = Text()

# ----
panel = Panel("https://macad.speckle.xyz/projects/af5d09c237/models/0aa2d6f0aa")
synchronous_receiver = SynchronousReceiver(
    Stream=panel,
    AutoReceive=False,
    ReceivedObjectId="696ed7f514c0cd036ac3873a5d1df7f9",
    StreamWrapper="https://macad.speckle.xyz/projects/af5d09c237/models/0aa2d6f0aa",
    selectedKitName="Objects")  # -> Data, Info
receive = Receive(
    Stream=panel,
    AutoReceive=False,
    CurrentComponentState="up_to_date",
    ExpandOutput=True,
    LastInfoMessage="ERVA Hofi @ 03/21/2025 22:37:18: Pushed 50 elements from Grasshopper. (id:88e91b94e1)",
    ReceiveOnOpen=False,
    ReceivedCommitId="88e91b94e1",
    StreamWrapper="https://macad.speckle.xyz/projects/af5d09c237/models/floorplates_v1",
    selectedKitName="Objects")  # -> Info, Data
surface = Surface(graft(synchronous_receiver.Data))
radius_bottom = Slider(26, range=10..30)
of_columns_main_beams = Slider(10, range=0..30)
radius_top = Slider(16, range=10..20)
is_planar = IsPlanar(Surface=surface, Interior=True)  # -> Planar, Plane
project = Project(Geometry=surface, Plane=is_planar.Plane)  # -> Geometry, Transform
area = Area(Geometry=project.Geometry)  # -> Area, graft(Centroid)
# Towers Structural System
list_item = ListItem(List=flatten(area.Centroid), Index=0, Wrap=True)  # -> Item1, Item
circle = Circle(Plane=list_item.Item1, Radius=radius_top)
circle_2 = Circle(Plane=list_item.Item, Radius=radius_bottom)
divide_curve = DivideCurve(Curve=circle, Count=of_columns_main_beams, Kinks=False)  # -> Points, Tangents, Parameters
divide_curve_2 = DivideCurve(Curve=circle_2, Count=of_columns_main_beams, Kinks=False)  # -> Points, Tangents, Parameters
line = Line(StartPoint=divide_curve.Points, EndPoint=divide_curve_2.Points)
surface_2 = Surface(flatten(surface))
panel_2 = Panel("""0
-1""")
cull_index = CullIndex(List=surface_2, Indices=panel_2, Wrap=True)  # -> graft(List)
split_with_breps = SplitWithBreps(Curve=line, Brep=flatten(cull_index))  # -> Curve, Points
panel_3 = Panel(line)
flip_matrix = FlipMatrix(Data=split_with_breps.Curve)
item = ListItem(List=flatten(split_with_breps.Curve), Index=0, Wrap=True)
len = Length(Curve=item)
curve = Curve(flip_matrix)
series = Series(Start="1", Step=1, Count="47")
panel_4 = Panel(len)
panel_5 = Panel(curve)
division = Division(A=len, B="500")
eval = Evaluate(F="3*((2+(N-2)*0.7)/N)", N=series)
ma = MassAddition(Input=eval)  # -> Result, PartialResults
panel_6 = Panel(division)
multiplication = Multiplication(A=division, B="1000")
total_load_kn = Panel(ma.Result)
sum_of_kn_floor = Panel(ma.PartialResults)
kn_floor = Panel(eval)
panel_7 = Panel(sum_of_kn_floor)
multiplication_2 = Multiplication(A=panel_7, B="10000")
expression = Expression(P=multiplication_2, Expression="Sqrt(P / (10^7))")
panel_8 = Panel(expression)
len_2 = Length(Curve=curve)
item_2 = ListItem(List=len_2, Index=0, Wrap=True)
multiplication_3 = Multiplication(A=panel_8, B=Slider(1.5, range=0..10))
rectangle = Rectangle(Plane=curve, XSize=graft(multiplication_3), YSize=graft(multiplication_3), Radius=0)  # -> Rectangle, Length
neg = Negative(Value=item_2)
num = Number(multiplication_2)
multiplication_4 = Multiplication(A=multiplication_3, B="100")
srf = Surface(rectangle.Rectangle)
Z = UnitZ(Factor=neg)
expression_2 = Expression(P=num, L=multiplication_4, b=multiplication_3, E="20e9", Expression="(P * L) / (b^2 * E)")
panel_9 = Panel(multiplication_3)
extr = Extrude(Base=srf, Direction=Z)
panel_10 = Panel(expression_2)
multiplication_5 = Multiplication(A=panel_10, B="1000")
panel_11 = Panel(multiplication_5)
panel_12 = Panel(multiplication)
item_3 = ListItem(List=panel_11, Index="-1", Wrap=True)

# ---- group: Displacement NO.
panel_13 = Panel(item_3)

# ----
panel_14 = Panel(multiplication)
larger = LargerThan(FirstNumber=panel_13, SecondNumber=panel_14)  # -> LargerThan, OrEqualTo
panel_15 = Panel(larger.OrEqualTo)
bool = Boolean(panel_15)
num_2 = Number(multiplication_2)
panel_16 = Panel(num_2)
# change "project" for "streams": https://macad.speckle.xyz/streams/a63c4e60ed
panel_17 = Panel("0a7a2c01a136ad89e2cfa5e002c9f1bcbe5656a1d0")
panel_18 = Panel("Receive_From_Compute Stream")
panel_19 = Panel("Bot Speckle Token")
txt_2 = Text()
sgetwt = StreamGetWithToken(Stream=txt_2, AuthToken=panel_17)

cso = CreateSpeckleObject(A=curve, selectedKitName="Objects")
cso_2 = CreateSpeckleObject(B=rectangle.Rectangle, selectedKitName="Objects")
cso_3 = CreateSpeckleObject(C=extr, selectedKitName="Objects")
panel_20 = Panel("https://macad.speckle.xyz/projects/7f5a70ef59/models/d62f789cfe")
cso_4 = CreateSpeckleObject(ColumnsCurves=cso, CrossSection=cso_2, Columns=cso_3, Loads=num_2, selectedKitName="Objects")

receive_2 = Receive(
    Stream=panel_20,
    AutoReceive=True,
    CurrentComponentState="up_to_date",
    ExpandOutput=True,
    LastInfoMessage="ERVA Hofi @ 03/22/2025 14:24:03: Pushed 176360 elements from Grasshopper. (id:01aa5097ef)",
    ReceiveOnOpen=False,
    ReceivedCommitId="01aa5097ef",
    StreamWrapper="https://macad.speckle.xyz/projects/7f5a70ef59/models/structure 01",
    selectedKitName="Objects")  # -> Info, Data
dso = DeconstructSpeckleObject(SpeckleObject=receive_2.Data, selectedKitName="Objects")  # -> Columns, ColumnsCurves, CrossSection, Loads
cso_5 = CreateSpeckleObject(A=receive_2.Data, selectedKitName="Objects")
dso_2 = DeconstructSpeckleObject(SpeckleObject=receive_2.Data, selectedKitName="Objects")  # -> Columns, ColumnsCurves, CrossSection, Loads
panel_21 = Panel(cso_5)
panel_22 = Panel(dso_2.Columns)
panel_23 = Panel(dso_2.Loads)
dso_3 = DeconstructSpeckleObject(SpeckleObject=dso_2.CrossSection, selectedKitName="Objects")
dso_4 = DeconstructSpeckleObject(SpeckleObject=dso_2.ColumnsCurves, selectedKitName="Objects")
num_3 = Number(dso_2.Loads)
panel_24 = Panel(num_3)
crv = Curve(dso_4)
panel_25 = Panel(crv)
num_4 = Number(dso_2.Loads)
crv_2 = Curve(dso_3)
area_2 = Area(Geometry=crv_2)  # -> Area, Centroid
panel_26 = Panel(area_2.Area)
scale = Scale(Geometry=crv_2, Center=area_2.Centroid, Factor=Slider(1.1, range=0..10))  # -> Geometry, Transform
srf_2 = Surface(scale.Geometry)
area_3 = Area(Geometry=scale.Geometry)  # -> Area, Centroid
expression_3 = Expression(x=area_3.Area, Expression="sqrt(x)")
panel_27 = Panel(expression_3)
item_4 = ListItem(List=flatten(panel_27), Index="1", Wrap=True)
panel_28 = Panel(item_4)
multiplication_6 = Multiplication(A=expression_3, B=Slider(1, range=0..10))
multiplication_7 = Multiplication(A=multiplication_6, B="100")
rectangle_2 = Rectangle(Plane=crv, XSize=graft(panel_28), YSize=graft(panel_28), Radius=0)  # -> Rectangle, Length
srf_3 = Surface(rectangle_2.Rectangle)
expression_4 = Expression(P=num_4, L=multiplication_7, b=multiplication_6, E="20e9", Expression="(P * L) / (b^2 * E)")
panel_29 = Panel(multiplication_6)
extrcrv = ExtrudeAlong(Base=srf_3, Curve=crv)
extrcrv_2 = ExtrudeAlong(Base=srf_2, Curve=crv)
volume = Volume(Geometry=extrcrv)  # -> Volume, Centroid
panel_30 = Panel(expression_4)
panel_31 = Panel(area_3.Area)
volume_2 = Volume(Geometry=extrcrv_2)  # -> Volume, Centroid
panel_32 = Panel(volume.Volume)
ma_2 = MassAddition(Input=flatten(volume.Volume))  # -> Result, PartialResults
ma_3 = MassAddition(Input=flatten(volume_2.Volume))  # -> Result, PartialResults
panel_33 = Panel(volume_2.Volume)
panel_34 = Panel(ma_2.Result)
panel_35 = Panel(ma_3.Result)
multiplication_8 = Multiplication(A=panel_30, B="1000")
panel_36 = Panel(multiplication_8)
item_5 = ListItem(List=flatten(panel_36), Index="-1", Wrap=True)
division_2 = Division(A=panel_35, B=panel_34)
panel_37 = Panel(division_2)

# ---- group: Displacement NO.
panel_38 = Panel(item_5)

# ----
larger_2 = LargerThan(FirstNumber=panel_38, SecondNumber=panel_12)  # -> LargerThan, OrEqualTo
panel_39 = Panel(larger_2.OrEqualTo)
bool_2 = Boolean(panel_39)
num_5 = Number(num_4)
filter = StreamFilter(Gate=bool, Stream0=cso_3, Stream1=cso_4)
gate = StreamGate(Stream=filter, Gate=bool)  # -> Target0, Target1
expression_5 = Expression(F=bool, FunctionA=cso_4, Expression="If(F, FunctionA, FunctionB)")
expression_6 = Expression(T=bool, FunctionA=cso_4, Expression="If(T, FunctionA, FunctionB)")
cso_6 = CreateSpeckleObject(A=expression_6, selectedKitName="Objects")
panel_40 = Panel(gate.Target1)

send = Send(
    Stream=panel_20,
    Data=gate.Target1,
    AutoSend=True,
    BaseId="a7ad54ac3ebf51cd9226b1f318b0aa45",
    CurrentComponentState="up_to_date",
    KitName="Objects",
    OutputWrappers="https://macad.speckle.xyz\t7f5a70ef59\t5e98a8955d",
    UseDefaultCache=True,
    selectedKitName="Objects")

cso_7 = CreateSpeckleObject(C=gate.Target0, selectedKitName="Objects")

# ----
# https://macad.speckle.xyz/projects/28a211b286/models/4104f63f5f
cso_8 = CreateSpeckleObject(A=crv, selectedKitName="Objects")
cso_9 = CreateSpeckleObject(B=scale.Geometry, selectedKitName="Objects")
cso_10 = CreateSpeckleObject(C=extrcrv_2, selectedKitName="Objects")
cso_11 = CreateSpeckleObject(ColumnsCurves=cso_8, CrossSection=cso_9, Columns=cso_10, Loads=num_5, selectedKitName="Objects")

expression_7 = Expression(T=bool_2, FunctionA=cso_11, Expression="If(T, FunctionA, FunctionB)")
filter_2 = StreamFilter(Gate=bool_2, Stream0=cso_10, Stream1=cso_11)

send_2 = Send(
    Stream=panel_20,
    Data=filter_2,
    AutoSend=False,
    BaseId="77a876728550fc5c514dc1a3534e6a4b",
    CurrentComponentState="expired",
    KitName="Objects",
    OutputWrappers="https://macad.speckle.xyz\t7f5a70ef59\t01aa5097ef",
    UseDefaultCache=True,
    selectedKitName="Objects")

gate_2 = StreamGate(Stream=filter_2, Gate=bool_2)  # -> Target0, Target1
panel_41 = Panel(gate_2.Target1)
cso_12 = CreateSpeckleObject(C=gate_2.Target0, selectedKitName="Objects")
filter_3 = StreamFilter(Gate=0, Stream0=cso_7, Stream1=cso_12)
panel_42 = Panel(filter_3)
ss = SynchronousSender(
    Data=cso_12,
    Stream=sgetwt,
    OutputWrappers="https://macad.speckle.xyz\t27b32e7bd2\tab5404b2dc",
    UseDefaultCache=True,
    selectedKitName="Objects")
